# Grasshopper definition GH程序.gh (Grasshopper 0.9.76)
# plug-ins: Kangaroo Components

# GH工作方式简示
pt = Point(Point(0, 0, 0))
series = Series(Start=0, Step=1, Count=10)
panel = Panel(series)
Z = UnitZ(Factor=series)
move = Move(Geometry=pt, Motion=Z)  # -> Geometry, Transform
panel_2 = Panel(Z)

# ---- group: 输入端
# 球壳程序
球心 = Point(<point referenced from the Rhino model>)
球面截面线 = Curve(<curve referenced from the Rhino model>)

# ----
# 越小越密(不建议更改)
纵向细分因子 = Slider(2.1, range=0..10)

# ----
# 生成球壳
number_slider = Slider(10, range=0..10)
Z_2 = UnitZ(Factor=1)
line = LineSDL(Start=球心, Direction=Z_2, Length=number_slider)
revsrf = Revolution(Curve=球面截面线, Axis=line, Domain=Domain(0, 6.283185307))
半球壳 = Surface(revsrf)

# ----
# 细分球壳
len = Length(Curve=球面截面线)
division = Division(A=len, B=纵向细分因子)
round = Round(Number=division)  # -> Nearest, Floor, Ceiling
divide = DivideCurve(Curve=球面截面线, Count=round.Floor, Kinks=False)  # -> Points, Tangents, Parameters
srf_cp = SurfaceClosestPoint(Point=divide.Points, Surface=半球壳)  # -> Point, UVPoint, Distance
item = ListItem(List=srf_cp.Point, Index=0, Wrap=True)
iso = IsoCurve(Surface=半球壳, UVPoint=srf_cp.UVPoint)  # -> UIsocurve, VIsocurve
crv = Curve(iso.UIsocurve)
len_2 = Length(Curve=crv)
division_2 = Division(A=len_2, B=纵向细分因子)
round_2 = Round(Number=division_2)  # -> Nearest, Floor, Ceiling

# ----
# 制作屏幕
number_slider_2 = Slider(1848, range=0..10000)
rectangle = Rectangle(Plane=PlaneXY(0, 0, 0), XSize=number_slider_2, YSize=number_slider_2, Radius=0)  # -> Rectangle, Length
vec = VectorXYZ(XComponent=expr("-x/2", number_slider_2), YComponent=expr("-x/2", number_slider_2), ZComponent=0)  # -> Vector, Length
move_2 = Move(Geometry=rectangle.Rectangle, Motion=vec.Vector)  # -> Geometry, Transform
boundary = BoundarySurfaces(Edges=move_2.Geometry)

# ---- group: 细分出的点
divide_2 = DivideCurve(Curve=crv, Count=round_2.Floor, Kinks=False)  # -> Points, Tangents, Parameters

# ----
# 去掉可能的重复点
merge = Merge(Data1=item, Data2=divide_2.Points)  # -> flatten(Result)
duppt = RemoveDuplicatePts(Points=merge, Tolerance=0.01)

# ----
# 点投影到屏幕上
number_slider_3 = Slider(1000, range=0..1000)
vec2pt = Vector2Pt(PointA=球心, PointB=duppt, Unitize=False)  # -> Vector, Length
line_2 = LineSDL(Start=球心, Direction=vec2pt.Vector, Length=number_slider_3)
xy = XYPlane(Origin=Point(0, 0, 0))
plx = LinePlane(Line=line_2, Plane=xy)  # -> Point, ParamL, ParamP
srf_cp_2 = SurfaceClosestPoint(Point=plx.Point, Surface=reparameterize(boundary))  # -> Point, UVPoint, Distance

# ----
# 画线准备生成圆柱
number_slider_4 = Slider(16, range=0..100)
vec2pt_2 = Vector2Pt(PointA=duppt, PointB=srf_cp_2.Point, Unitize=False)  # -> Vector, Length
amp = Amplitude(Vector=vec2pt_2.Vector, Amplitude=number_slider_4)
move_3 = Move(Geometry=duppt, Motion=expr("-x", amp))  # -> Geometry, Transform
move_4 = Move(Geometry=duppt, Motion=amp)  # -> Geometry, Transform
ln = Line(StartPoint=move_4.Geometry, EndPoint=move_3.Geometry)

# ----
# 分析投影后的点在屏幕上的位置
pdecon = Deconstruct(Point=srf_cp_2.UVPoint)  # -> XComponent, YComponent, ZComponent
num = Number(flatten(pdecon.XComponent))
panel_3 = Panel(srf_cp_2.UVPoint)
num_2 = Number(flatten(pdecon.YComponent))
dom = ConstructDomain(DomainStart="0", DomainEnd="60")
dom_2 = ConstructDomain(DomainStart="0", DomainEnd="60")
bnd = Bounds(Numbers=num)
bnd_2 = Bounds(Numbers=num_2)
remap = RemapNumbers(Value=pdecon.XComponent, Source=bnd, Target=dom)  # -> Mapped, Clipped
remap_2 = RemapNumbers(Value=pdecon.YComponent, Source=bnd_2, Target=dom_2)  # -> Mapped, Clipped
panel_4 = Panel(bnd)
panel_5 = Panel(bnd_2)
pt_2 = ConstructPoint(XCoordinate=remap.Mapped, YCoordinate=remap_2.Mapped, ZCoordinate=0)

# ----
# 用位置数据在图片上采样
image = ImageSampler(pt_2, FilePath="F:\我.jpg", Filter="Value", Interpolate=False, Umax=60, Umin=0, Vmax=60, Vmin=0, Wrap=1)

# ----
# 把球面变成球壳（加厚度）
number_slider_5 = Slider(2, range=0..10)
srf = Surface(半球壳)
mesh_uv = MeshSurface(Surface=srf, UCount=5, VCount=5, Overhang=True, Equalize=False)
edges = BrepEdges(Brep=srf)  # -> Naked, Interior, NonManifold
offset = Offset(Surface=srf, Distance=number_slider_5, Retrim=True)
edges_2 = BrepEdges(Brep=offset)  # -> Naked, Interior, NonManifold
loft = Loft(
    Curves=[edges.Naked, edges_2.Naked],
    Options={Adjust=False, Closed=False, LoftEnds=0, LoftSimp=0, LoftType=0, Rebuild=10, Refit=0.01})
merge_2 = Merge(Data1=srf, Data2=loft, Data3=offset)  # -> flatten(Result)
join = BrepJoin(Breps=merge_2)  # -> Breps, Closed

# ---- group: 画圆柱 我红了但是不用理我
pipe = Pipe(Curve=ln, Radius=image, Caps=1)  # -> simplify(graft(Pipe))

# ----
# 清理切割用管子的数据结构
clean = CleanTree(RemoveNulls=True, RemoveInvalid=True, RemoveEmpty=True, Tree=flatten(pipe))

# ----
# 切!（此步极慢4790k约耗时450秒）
sdiff = SolidDifference(BrepsA=join.Breps, BrepsB=clean)  # disabled

# ----
# 右键Bake这个mesh即可
mesh = MeshBrep(
    Brep=sdiff,
    Settings={GridMaxCount=0, GridMinCount=16, JaggedSeams=False, MaxEdgeLength=0, MinEdgeLength=0.0001, MinTolerance=0, Refine=True, RefineAngle=0, RelativeTolerance=0.65, SimplePlanes=True, Tolerance=0})  # disabled
